# Grasshopper definition base_template_3D.ghx (Grasshopper 1.0.7)

x_spacing = Slider(10, range=0..20)
y_spacing = Slider(10, range=0..20)
z_spacing = Slider(10, range=0..20)
box = DomainBox(Base=PlaneXY(0, 0, 0), X=x_spacing, Y=y_spacing, Z=z_spacing)
